# Grasshopper definition tester.ghx (Grasshopper 1.0.7)

boolean_toggle = BooleanToggle(False)  # disabled
boolean_toggle_2 = BooleanToggle(True)  # disabled
ghpython_script = GhPythonScript()  # -> out, a, b, c, d
# ---------- ghpython_script: Python ----------
from writehops import HOPSWriter, FrenchRidgeProcess, DoubleCutProcess
from compas_rhino import unload_modules

from compas_rhino.conversions import frame_to_rhino, point_to_rhino

from compas.geometry import Transformation, Frame, Point

import Rhino.Geometry as rg

unload_modules("writehops")

hopper = HOPSWriter(760.0)
process =  DoubleCutProcess(
            hopper,
            {
                "angle1": 66.03,
                "angle2": 158.81,
                "inclination1": 78.44,
                "inclination2": 76.67,
                "ref_face": 2,
                "startx": 590.10,
                "starty": 46.53,
            },
        )

b = [process.frame1, process.frame2]
# ---------- end ghpython_script ----------
ghpython_script_2 = GhPythonScript()  # -> out, rhino_points_part1, rhino_points_part2, plane; disabled
# ---------- ghpython_script_2: Python ----------
import rhinoscriptsyntax as rs
import Rhino.Geometry as rg
import math

width = 60

# First Part Points
points_part1 = [
    (-175.232, 59.205, -58.4),
    (0, width/2, 0),
    (width, width/3, 0),
    (235.232, -9.205, 0)
]

# Second Part Points
points_part2 = [
    (127.303, -123.908, 0),
    (3.395, -251.211, 0),
    (-39.031, -294.8, 0),
    (-162.939, -422.103, 0),
]

beta, theta = 225, 13.263
plane = rg.Plane(rg.Point3d(875.036,-170.235,89.189), rg.Vector3d.XAxis, rg.Vector3d.YAxis)
plane.Rotate(math.radians(beta), plane.ZAxis, plane.Origin)
plane.Rotate(math.radians(theta), plane.XAxis, plane.Origin)

T = rg.Transform.ChangeBasis(plane, rg.Plane.WorldXY)

rhino_points_part1 = [rg.Point3d(*pt) for pt in points_part1]
rhino_points_part2 = [rg.Point3d(*pt) for pt in points_part2]


[pt.Transform(T) for pt in rhino_points_part2]
# Create points in Rhino
# ---------- end ghpython_script_2 ----------
ghpython_script_3 = GhPythonScript(face_front=boolean_toggle, end=boolean_toggle_2)  # -> out, plane, points; inputs pts: list; disabled
# ---------- ghpython_script_3: Python ----------
import Rhino.Geometry as rg
from copy import deepcopy
import math

# Define your variables (length, leadout, width)
length = 760
leadout = 200
width = 60

# Initialize face_front variable as per the condition



# Set up the plane and points
if face_front:
    if end:
        plane_pt = rg.Point3d(length, 0, width / 2)
    else:
        plane_pt = rg.Point3d(0, 0, width / 2)
    plane = rg.Plane(plane_pt, rg.Vector3d.XAxis, rg.Vector3d.YAxis)
    beta, theta = -45, 13.263
    beta = beta if end else 45
    plane.Rotate(math.radians(beta), plane.ZAxis, plane.Origin)
    plane.Rotate(math.radians(theta), plane.XAxis, plane.Origin)
    if end:
        point1 = rg.Point3d(length - width, 0, width / 3)
        point2 = rg.Point3d(length - width, width, width / 2)
    else:
        point1 = rg.Point3d(width, 0, width / 3)
        point2 = rg.Point3d(width, width, width / 2)
else:
    if end:
        plane_pt = rg.Point3d(length, width, width / 2)
    else:
        plane_pt = rg.Point3d(0, width, width / 2)
        print "11"
    plane = rg.Plane(plane_pt, rg.Vector3d.XAxis, rg.Vector3d.YAxis)
    beta, theta = 135, 13.263
    beta = beta if end else 45
    plane.Rotate(math.radians(beta), plane.ZAxis, plane.Origin)
    plane.Rotate(math.radians(theta), plane.YAxis, plane.Origin)
    if end:
        point1 = rg.Point3d(length - width, 0, width / 2)
        point2 = rg.Point3d(length - width, width, width / 3)
    else:
        point1 = rg.Point3d(width, 0, width / 2)
        point2 = rg.Point3d(width, width, width / 3)

# Calculate vector and transformation
vec = plane_pt-point1
vec.Unitize()
vec = vec*leadout
Tr = rg.Transform.Translation(vec)

# Apply transformations to points
point11 = deepcopy(point1)
point11.Transform(Tr)
point21 = deepcopy(point2)
point21.Transform(Tr)

#T = rg.Transform.ChangeBasis(rg.Plane.WorldXY, plane)
#
#point1.Transform(T)
#point2.Transform(T)
#point11.Transform(T)
#point21.Transform(T)

# Collect points
points = [point11, point1, point2, point21]

# Format the points for CNC output
formatted_points = []
for pt in points:
    formatted_points.append("G01({:.3f},{:.3f},{:.3f},0,0,2)".format(pt.X, pt.Y, pt.Z))

# Define the free plane with origin and beta/theta values
plane_origin = plane_pt
plane_origin_str = "EBENEF({:.3f},{:.3f},{:.3f},{},{},0,0)".format(plane_origin.X, plane_origin.Y, plane_origin.Z, theta, beta)

# Combine the formatted output
output = "; Free Plane Definition\n" + plane_origin_str + "\n; Points\n" + "\n".join(formatted_points)

print(output)
# ---------- end ghpython_script_3 ----------
plane = Plane(ghpython_script.a)
draw = Draw(cg=ghpython_script.b)  # -> rg
#   port cg: The COMPAS geometry or datastructure to be drawn.
#   port rg: The Rhino geometry object.
# ---------- draw: Python ----------
"""
Draws COMPAS geometry in Grasshopper.
"""
from ghpythonlib.componentbase import executingcomponent as component

from compas.scene import SceneObject


class CompasToRhinoGeometry(component):
    def RunScript(self, cg):
        if not cg:
            return None

        return SceneObject(cg).draw()
# ---------- end draw ----------
point = Point(ghpython_script_2.rhino_points_part2)  # disabled
number_slider = Slider(78.44, range=0..1000)
ghpython_script_4 = GhPythonScript(
    x=Slider(66.03, range=0..100),
    y=Slider(78.44, range=0..100),
    z=Slider(158.81, range=0..1000),
    u=Slider(76.67, range=0..100))  # -> out, a, b
# ---------- ghpython_script_4: Python ----------
from compas.geometry import Frame, Point, Transformation
import math
fr = Frame.worldXY()
fr.rotate(-math.pi/2, fr.xaxis, fr.point)
T = Transformation.from_change_of_basis(Frame.worldXY(), fr)
fr.point = Point(590.10, 46.53, 0).transformed(T)
fr.rotate(math.radians(x), fr.zaxis, fr.point)
fr.rotate(math.radians(y), fr.xaxis, fr.point)
R = Transformation.from_frame(fr).rotation
print fr.euler_angles()
print [math.degrees(a) for a in fr.euler_angles()]
theta_z = math.atan2(R[1, 0], R[0, 0])
print math.degrees(theta_z)
frr = Frame.worldXY()
frr.rotate(-math.pi/2, frr.xaxis, frr.point)
frr.point = Point(590.10, 46.53, 0).transformed(T)
frr.rotate(math.radians(z), frr.zaxis, frr.point)
frr.rotate(math.radians(u), frr.xaxis, frr.point)

from compas_rhino.conversions import frame_to_rhino

a = frame_to_rhino(fr)
b = frame_to_rhino(frr)
# ---------- end ghpython_script_4 ----------
plane_2 = Plane(ghpython_script_4.a)
